# Grasshopper definition ImageRegionSelector.gh (Grasshopper 0.9.76)
# plug-ins: Python Interpreter

ladybug = Ladybug_Ladybug()  # -> Vviiiiiiiiiizzz; plug-in component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
path = FilePath("C:\Users\cmackey\Documents\GitHub\SolarSculptor\resources\testImage\GradientImg.png")
img = ImportImage(File=path, XSamples="100", YSamples="100")
demesh = DeconstructMesh(Mesh=img)  # -> Vertices, Faces, Colours, Normals
argb = SplitARGB(Colour=demesh.Colours)  # -> Alpha, Red, Green, Blue
meshselector = Ladybug_MeshThresholdSelector(inputMesh=img, analysisResult=flatten(argb.Red), operator="<")  # -> readMe, totalValue, areaMeetsThresh, newColoredMesh, newMeshOutline; plug-in component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
